# Grasshopper definition 221017_unroll_panel+niche.ghx (Grasshopper 1.0.7)
# plug-ins: Human

input = DataInput(
    Destination="/Volumes/GoogleDrive-110500231569640047002/Общие диски/CONTEXTMACHINE/PROJECTS/2202_Lahta_Arc/Lahta Arc_WORK/SF/from_VV/221004_Recess_for_mockup.ghdata",
    RelativePath="/Volumes/GoogleDrive-110500231569640047002/Общие диски/CONTEXTMACHINE/PROJECTS/2202_Lahta_Arc/Lahta Arc_WORK/SF/from_VV/221004_Recess_for_mockup.ghdata|../../../../../../Volumes/GoogleDrive-110500231569640047002/Общие диски/CONTEXTMACHINE/PROJECTS/2202_Lahta_Arc/Lahta Arc_WORK/SF/from_VV/221004_Recess_for_mockup.ghdata",
    UpdateDelay=50000)  # -> Hyp_recess_top, Hyp_recess_Vert_01, Hyp_recess_Vert_02, Hyp_recess_Ribs
srf = Surface(flatten(input.Hyp_recess_top))
srf_2 = Surface(flatten(input.Hyp_recess_Vert_01))
srf_3 = Surface(flatten(input.Hyp_recess_Vert_02))
input_2 = DataInput(
    Destination="/Volumes/GoogleDrive-110500231569640047002/Общие диски/CONTEXTMACHINE/PROJECTS/2202_Lahta_Arc/Lahta Arc_WORK/MP/gh_data/panel_test_2.ghdata",
    RelativePath="/Volumes/GoogleDrive-110500231569640047002/Общие диски/CONTEXTMACHINE/PROJECTS/2202_Lahta_Arc/Lahta Arc_WORK/MP/gh_data/panel_test_2.ghdata|../../../../../../Volumes/GoogleDrive-110500231569640047002/Общие диски/CONTEXTMACHINE/PROJECTS/2202_Lahta_Arc/Lahta Arc_WORK/MP/gh_data/panel_test_2.ghdata",
    UpdateDelay=50000)  # -> Hyp_panels_surf_3, Hyp_panels_surf_6
panel = Panel("""301
302
303""")
trim = TrimTree(Tree=input.Hyp_recess_Ribs, Depth=1)
pt = Point(Point(-11.5, 29.0011855, 0))
srf_4 = Surface(input_2.Hyp_panels_surf_6)
pt_2 = Point(Point(0, 3.166488276, 0))
item = ListItem(List=srf_2, Index=panel, Wrap=True)
item_2 = ListItem(List=srf_3, Index=panel, Wrap=True)
pt_3 = Point(Point(-6.5, 29.0011855, 0))
tstat = TreeStatistics(Tree=trim)  # -> Paths, Length, Count
input_3 = DataInput(
    Destination="/Volumes/GoogleDrive-110500231569640047002/Общие диски/CONTEXTMACHINE/PROJECTS/2202_Lahta_Arc/Lahta Arc_WORK/MP/gh_data/panel_test_2.ghdata",
    RelativePath="/Volumes/GoogleDrive-110500231569640047002/Общие диски/CONTEXTMACHINE/PROJECTS/2202_Lahta_Arc/Lahta Arc_WORK/MP/gh_data/panel_test_2.ghdata|../../../../../../Volumes/GoogleDrive-110500231569640047002/Общие диски/CONTEXTMACHINE/PROJECTS/2202_Lahta_Arc/Lahta Arc_WORK/MP/gh_data/panel_test_2.ghdata",
    UpdateDelay=50000)  # -> Hyp_panels_surf_3, Hyp_panels_surf_6
panel_2 = Panel("""0
1""")
pdecon = Deconstruct(Point=pt_2)  # -> XComponent, YComponent, ZComponent
flip = Flip(Surface=srf_4)  # -> Surface, Result
item_3 = ListItem(List=tstat.Paths, Index=panel, Wrap=True)
weave = Weave(Pattern=panel_2, Stream0=item, Stream1=item_2, NullGaps=False)
number_slider = Slider(1.5, range=0..10)
flip_2 = Flip(Surface=input_3.Hyp_panels_surf_6)  # -> flatten(Surface), Result
branch = TreeBranch(Tree=trim, Path=item_3, MaintainPaths=True)  # -> flatten(Branch)
flip_3 = Flip(Surface=weave)  # -> flatten(Surface), Result
pdecon_2 = Deconstruct(Point=pt)  # -> XComponent, YComponent, ZComponent
item_4 = ListItem(List=srf, Index=panel, Wrap=True)
item_5 = ListItem(List=flip.Surface, Index=0, Wrap=True)  # -> flatten(Item), flatten(Item1)
partition = PartitionList(List=flip_2.Surface, Size=Slider(2, range=0..10))
partition_2 = PartitionList(List=branch, Size=Slider(6, range=0..10))
partition_3 = PartitionList(List=flip_3.Surface, Size=Slider(2, range=0..10))
pdecon_3 = Deconstruct(Point=pt_3)  # -> XComponent, YComponent, ZComponent
panel_3 = Panel("""0
1
0
1
0
1""")
addition = Addition(A=number_slider, B=Slider(0.5, range=0..10))
file = ReadFile(File="/Users/sofyadobycina/Documents/GitHub/mmodel/panels_gh/main.py", PerLineParse=False)
code = Code("""\"\"\"Provides a scripting component.
    Inputs:
        x: The x script variable
        y: The y script variable
    Output:
        a: The a output variable\"\"\"

__author__ = "andrewastakhov"

DUMP_NAME = "ghoutput"
DUMP_FP = "/Users/{}/dumps/{}.json".format(__author__, DUMP_NAME)

import rhinoscriptsyntax as rs
import json
from ghpythonlib.treehelpers import list_to_tree
import Rhino.Geometry as rg

def d(x, y):
    for i, j in zip(x, y):
        yield [i.From.X, i.From.Y],[j.From.X, j.From.Y]

def file_dump(data, fp=DUMP_FP):
    f = open(fp, "wb")
    json.dump(data, f)
    f.close()


data = {
    "lines": list(d(x,y))
}

a = json.dumps(data)

if dump:
    file_dump(data)""")
srf_5 = Surface(flatten(flip.Surface))
pt_4 = ConstructPoint(XCoordinate=pdecon.XComponent, YCoordinate=addition, ZCoordinate=0)
rotate = Rotate(Geometry=item_5.Item1, Angle=degrees(Slider(180, range=0..1000)), Plane=PlaneXY(0, 0, 0))  # -> Geometry, Transform
pt_5 = ConstructPoint(XCoordinate=pdecon_2.XComponent, YCoordinate=Slider(33.8, range=0..100), ZCoordinate=0)
item_6 = ListItem(List=srf_5, Index=0, Wrap=True)
python = GhPythonScript(back_side=item_4, niche_side=partition_3, ribs=partition_2, panels=partition)  # -> out, pack; inputs back_side: list of Surface, niche_side: tree of Brep, ribs: tree of Surface, panels: tree of Brep
# ---------- python: Python ----------
__author__ = "sofyadobycina"

import rhinoscriptsyntax as rs
import ghpythonlib.treehelpers as th


panels = th.tree_to_list(panels, lambda x: x[0])
ribs = th.tree_to_list(ribs, lambda x: x[0])
niche_side = th.tree_to_list(niche_side, lambda x: x[0])


pack = []
for p, n, r, b in zip(panels, niche_side, ribs, back_side):
    #r = th.list_to_tree(r)
    pack.append([p[0], p[1], n[0], n[1], r, b])

#pack = th.list_to_tree(pack)

print(pack)
# ---------- end python ----------
pt_6 = ConstructPoint(XCoordinate=pdecon_3.XComponent, YCoordinate=0, ZCoordinate=0)
cir = Circle(Plane=pt_4, Radius=number_slider)
python_2 = GhPythonScript(Code=file, Panels=srf_5, Tip=panel_3)  # -> Out, Fres, Cut, Panel
file_2 = ReadFile(File="/Users/sofyadobycina/Documents/GitHub/mmodel/panels_gh/main_niche_unroll.py", PerLineParse=False)
panel_4 = Panel(python.pack)
file_3 = ReadFile(File="/Users/sofyadobycina/Documents/GitHub/mmodel/panels_gh/main.py", PerLineParse=False)
file_4 = ReadFile(File="/Users/sofyadobycina/Documents/GitHub/mmodel/panels_gh/unroll_pack.py", PerLineParse=False)
flip_4 = FlipMatrix(Data=python_2.Fres)
flip_5 = FlipMatrix(Data=python_2.Cut)
number_slider_2 = Slider(0, range=0..10)
python_3 = GhPythonScript(Code=file_2)  # -> Out, Niche_side, Back_niche, Ribs
python_4 = GhPythonScript(Code=file_3)  # -> Out, Panel
item_7 = ListItem(List=python.pack, Index=Slider(3, range=0..10), Wrap=True)
item_8 = ListItem(List=flip_4, Index=number_slider_2, Wrap=True)
item_9 = ListItem(List=flip_5, Index=number_slider_2, Wrap=True)
item_10 = ListItem(List=python_2.Panel, Index=0, Wrap=True)
python_5 = GhPythonScript(
    Code=file_4,
    Panel=python_4.Panel,
    Niche_side=python_3.Niche_side,
    Back_niche=python_3.Back_niche,
    Ribs=python_3.Ribs,
    Unroll_elems=item_7,
    X=pt_6,
    Y=pt_5,
    Circle=cir)  # -> Out, Pack_unrolls, Packs
previewlw = CustomPreviewLineweights(Geometry=item_9, Shader=ColourSwatch(SwatchColor=RGB(178, 255, 0)), Thickness=Slider(2, range=0..10), Absolute=False)
previewlw_2 = CustomPreviewLineweights(Geometry=item_8, Shader=ColourSwatch(SwatchColor=RGB(255, 0, 0)), Thickness=Slider(2, range=0..10), Absolute=False)
python_6 = GhPythonScript(x=python_5.Packs)  # -> out, a
# ---------- python_6: Python ----------
__author__ = "sofyadobycina"

import rhinoscriptsyntax as rs

print dir(x)
a=x.niche_r.niche.join_region
# ---------- end python_6 ----------
bang = ExplodeTree(Data=python_5.Pack_unrolls)  # -> _0000, _0001, _0010, _0011, _0020, _0021, _0022, _0030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
group = Group(Objects=[bang._0000, bang._0001])  # -> flatten(Group)
group_2 = Group(Objects=[bang._0010, bang._0011])  # -> flatten(Group)
group_3 = Group(Objects=[bang.Branch10, bang.Branch11])  # -> flatten(Group)
group_4 = Group(Objects=[bang._0022, bang._0021, bang._0020])  # -> flatten(Group)
group_5 = Group(Objects=[bang._0032, bang._0031])  # -> flatten(Group)
panel_5 = Panel(bang._0030)
item_11 = ListItem(List=group_4, Index=0, Wrap=True)  # -> Item, Item1, Item2, Item3, Item4, Item5
number_slider_3 = Slider(45, range=0..100)
number_slider_4 = Slider(45, range=0..100)
previewlw_3 = CustomPreviewLineweights(Geometry=item_11.Item2, Shader=ColourSwatch(SwatchColor=RGB(191, 255, 0)), Thickness=2, Absolute=False)
previewlw_4 = CustomPreviewLineweights(Geometry=item_11.Item1, Shader=ColourSwatch(SwatchColor=RGB(255, 0, 0)), Thickness=2, Absolute=False)
previewlw_5 = CustomPreviewLineweights(Geometry=item_11.Item, Shader=ColourSwatch(SwatchColor=RGB(255, 255, 255)), Thickness=2, Absolute=False)
python_7 = GhPythonScript(panel=item_10, niche=number_slider_4, bottom=number_slider_4, top=Slider(35, range=0..100))  # -> out, a, flatten(frame)
# ---------- python_7: Python ----------
__author__ = "sofyadobycina"

import rhinoscriptsyntax as rs
import Rhino.Geometry as rh
import math

def offset(crv, ofs_dist, extend=None):
    c = rh.Curve.Offset(crv, rh.Plane.WorldXY, ofs_dist, 0.01, rh.CurveOffsetCornerStyle.Sharp)[0]
    if extend is not None:
        c = rh.Curve.Extend(c, rh.Interval(extend[0], extend[1]))
    return c
    
def bound_rec(crv):
    join = rh.Curve.JoinCurves(crv)[0]
    bound_rec = rh.PolyCurve.GetBoundingBox(join, rh.Plane.WorldXY)
    return bound_rec
    
def intersect(values):
    res = []
    for i, v in enumerate(values):
        param = []
        for ind, val in enumerate(values):
            if i != ind:
                inters = rs.CurveCurveIntersection(v, val)
                if inters is not None:
                    param.append(inters[0][5])
        param = sorted(param)
        if len(param) != 1 and i!=0:
            trimed = rh.Curve.Trim(v, param[0], param[1])
        elif i==3:
            trimed = rh.Curve.Trim(v, v.Domain[0], param[0])
        elif i==0 and len(param) != 1:
            trimed = rh.Curve.Trim(v, param[1], v.Domain[1])
        else:
            trimed = rh.Curve.Trim(v, param[0], v.Domain[1])
        res.append(trimed)
    return res


class FramePanel:
    niche = 45
    bottom = 45
    top = 35
    diag = 20
    
    bottom_rec = 30
    side_rec = 30
    
    
    @property
    def frame_offset(self):
        self._frame_offset = rh.Curve.JoinCurves(self.all_offset()[0:3])
        return self._frame_offset
    
    @property
    def p_top(self):
        self._p_top= self.all_offset()[3]
        return self._p_top
    
    @property
    def frame_all(self):
        self._frame_all = rh.Curve.JoinCurves(self.all_offset())
        return self._frame_all
    
    @property
    def bound_frame(self):
        rec = bound_rec(self.frame_all)
        min_transl = rh.Point3d(rec.Min[0] - FramePanel.side_rec, rec.Min[1] - FramePanel.bottom_rec, 0)
        self._bound_frame = rh.Rectangle3d(rh.Plane.WorldXY, min_transl, rec.Max)
        return self._bound_frame
        
    def __init__(self, panel):
        self.panel = panel
        self.p_niche = self.panel.fres[1]
        self.p_bottom = self.panel.fres[0]
        
    def all_offset(self):
        niche = offset(self.p_niche, FramePanel.niche, extend=[self.p_niche.Domain[0]+200, self.p_niche.Domain[1]-200])

        if niche is None:
            niche = offset(self.p_niche, FramePanel.niche, extend=[self.p_niche.Domain[0]-200, self.p_niche.Domain[1]+200])

        bottom = offset(self.p_bottom, FramePanel.bottom, extend=[self.p_bottom.Domain[0]-200, self.p_bottom.Domain[1]])
        top_s = self.top_side()
        top = offset(self.top_side(), FramePanel.top, extend=[top_s.Domain[0], top_s.Domain[1]+200])
        diag = offset(self.diag_side(), FramePanel.diag)

        all_offset = [bottom, diag, niche, top]
        
        all_offset = intersect(all_offset)
        return all_offset

        
    def top_side(self):
        bound = bound_rec(self.panel.fres)
        top_side = bound.GetEdges()[2]
        return top_side.ToNurbsCurve()
        
    def diag_side(self):
        st = self.panel.niche.top_part.PointAtEnd
        en = self.panel.side[0].top_part.PointAtStart
        p = self.panel.niche.fres.PointAtEnd
        
        crv = rh.Line.ToNurbsCurve(rh.Line(st, en))
        
        crv_d = crv.PointAtLength(rh.Curve.DivideByCount(crv, 2, False)[0])
        FramePanel.diag = rh.Point3d.DistanceTo(p, crv_d) + 10
        return crv


    
FramePanel.niche = niche
FramePanel.bottom = bottom
FramePanel.top = top
aa = FramePanel(panel)

#a = aa.all_offset()
a = aa.bound_frame
frame = aa.frame_offset
# ---------- end python_7 ----------
python_8 = GhPythonScript(panel=item_10, niche=number_slider_3, bottom=number_slider_3, top=Slider(35, range=0..100))  # -> out, a, flatten(frame); same code as python_7
panel_6 = Panel(python_7.frame)
item_12 = ListItem(List=python_7.a, Index=0, Wrap=True)  # -> flatten(Item)
item_13 = ListItem(List=python_7.frame, Index=0, Wrap=True)  # -> flatten(Item)
previewlw_6 = CustomPreviewLineweights(Geometry=item_12, Shader=ColourSwatch(SwatchColor=RGB(0, 81, 255)), Thickness=Slider(4, range=0..10), Absolute=False)
previewlw_7 = CustomPreviewLineweights(Geometry=item_13, Shader=ColourSwatch(SwatchColor=RGB(0, 191, 255)), Thickness=Slider(3, range=0..10), Absolute=False)
